# Grasshopper definition 02_01_DF_Attractors_2015.02.14.gh (Grasshopper 0.9.76)

panel = Panel("Notes:")

# ---- group: ATTRACTOR, DISTANCE / INPUT ATTRACTOR
pt = Point(Point(55.94676253, 99.33810301, 0))

# ---- group: ATTRACTOR, DISTANCE
# Create grid of geometry to respond to attractor point input
slider = Slider(10, range=0..20)
slider_2 = Slider(15, range=0..20)
recgrid = Rectangular(Plane=PlaneXY(0, 0, 0), SizeX=slider, SizeY=slider, ExtentX=slider_2, ExtentY=slider_2)  # -> Cells, Points
pt_2 = Point(recgrid.Points)
dist = Distance(PointA=recgrid.Points, PointB=pt)
circle = CircleCNR(Center=pt_2, Normal=Vector(0, 0, 1), Radius=expr("x/12", dist))
bnd = Bounds(Numbers=flatten(circle))
dom = Domain(DomainStart=Slider(0, range=0..20), DomainEnd=Slider(5.2832, range=0..10))
remap = RemapNumbers(Value=flatten(circle), Source=bnd, Target=dom)  # -> Mapped, Clipped
circle_2 = CircleCNR(Center=flatten(pt_2), Normal=Vector(0, 0, 1), Radius=remap.Mapped)
panel_4 = Panel(remap.Mapped)

# ---- group: ATTRACTOR, CLOSE PT / INPUT SRF
# Create scalar differance across geo about a surface based on attractors, closest point
srf = Surface(<surface referenced from the Rhino model>)

# ---- group: ATTRACTOR, FIELD CHRAGE / INPUT PT
# Create a field, charge, based on point inputs and visualize
pt_3 = Point(<point referenced from the Rhino model>)

# ---- group: ATTRACTOR, FIELD CHRAGE / INPUT PTS
pt_4 = Point(<point referenced from the Rhino model>)
pt_5 = Point([<point referenced from the Rhino model> x13])

# ---- group: ATTRACTOR, CLOSE PT
# Attach the values from the attractors to the height input on the surface box component
# Set attractor points
# 
# Right click and set one pt.
# Connect vaulues into the 'H' - height input of the surface box component in order to scale the surface geomerty locally based on attractor points.
u_value = Slider(15, range=0..20)
v_value = Slider(15, range=0..20)
divide = DivideDomain²(Domain=srf, UCount=u_value, VCount=v_value)
subsrf = Isotrim(Surface=srf, Domain=divide)
area = Area(Geometry=subsrf)  # -> Area, Centroid
pt_01 = Point(<point referenced from the Rhino model>)
pt_02 = Point(<point referenced from the Rhino model>)
cp = ClosestPoint(Point=area.Centroid, Set=[pt_01, pt_02])  # -> ClosestPoint, CPIndex, Distance
amount_of_scaling = Slider(10, range=0..2000)
maximum_scale_size = Slider(1.5, range=0..20)
ln = Line(PointA=cp.ClosestPoint, PointB=area.Centroid)
dist_2 = Distance(PointA=cp.ClosestPoint, PointB=area.Centroid)
division = Division(A=dist_2, B=amount_of_scaling)
min = Minimum(A=division, B=maximum_scale_size)
values_from_the_attractors = Data(min)

# ---- group: ATTRACTOR, FIELD CHRAGE
box = Box2Pt(PointA=pt_3, PointB=pt_4, Plane=PlaneXY(0, 0, 0))
bbox = BoundingBox(Content=pt_5, Plane=PlaneXY(0, 0, 0), UnionBox=True)  # -> Box, Box_2

# ----
md_slider = MDSlider(slider_value=Point(0.5, 0.5, 0.5), SliderMode=0, x_domain=Domain(0, 1), y_domain=Domain(0, 1), z_domain=Domain(0, 1))
evalsrf = EvaluateSurface(Surface=reparameterize(subsrf), Point=md_slider)  # -> Point, Normal, Frame
circle_3 = CircleCNR(Center=evalsrf.Point, Normal=evalsrf.Normal, Radius=values_from_the_attractors)

# ---- group: ATTRACTOR, FIELD CHRAGE
pcharge = PointCharge(Point=pt_3, Charge=1, Decay=2)
field = Field(pcharge)

evf = EvaluateField(Field=field, Point=pt_5)  # -> Tensor, Strength
fline = FieldLine(Field=field, Point=pt_5, Steps=1000, Accuracy=0.1, Method=3)

panel_5 = Panel(evf.Strength)

ftensor = TensorDisplay(Field=field, Section=box, Samples=1000)
fscalar = ScalarDisplay(Field=field, Section=bbox.Box, Samples=1000)
fdir = DirectionDisplay(Field=field, Section=box, Samples=1000)
