# Grasshopper definition 00_01_DF_Lists_Simple.gh (Grasshopper 0.9.76)

panel = Panel("""0
10
20
30
40
50""")

# ---- group: Crv-A
crv = Curve(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)

# ---- group: Crv-B
crv_2 = Curve(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)

# ----
# Data Matching: A rule used when a component has access to differently sized list inputs.
number_slider = Slider(4, range=2..20)

# ---- group: Create Point
pt = ConstructPoint(XCoordinate=panel, YCoordinate=0, ZCoordinate=0)

# ----
divide = DivideCurve(Curve=crv, Count=Slider(5, range=1..20), Kinks=False)  # -> Points, Tangents, Parameters
divide_2 = DivideCurve(Curve=crv_2, Count=Slider(20, range=1..20), Kinks=False)  # -> Points, Tangents, Parameters
# List - Introduction: Creating a List of Points
# --
# A List is a data structure consisting of an ordered set of elements or items.
# It's helpful to think of Grasshopper in terms of flow, since the graphical interface is designed to have information flow into and out of specific types of components. However, it is the data (such as lists of points, curves, surfaces, strings, booleans, and numbers, etc.) that define the information flowing in and out of the components
# --
# Lists are made up of items and their corresponding index
panel_2 = Panel("Index")

# ---- group: Interpolate Line
intcrv = Interpolate(Vertices=pt, Degree=3, Periodic=False, KnotStyle=1)  # -> Curve, Length, Domain

# ----
points = Panel(pt)

# ---- group: Point List Display
points_2 = PointList(Points=pt, Tags=True, Lines=True, Size=number_slider)

# ----
short = ShortestList(ListA=divide.Points, ListB=divide_2.Points, TrimMode=3)  # -> ListA, ListB
long = LongestList(ListA=divide.Points, ListB=divide_2.Points, PaddingMode=2)  # -> ListA, ListB
crossref = CrossReference(ListA=divide.Points, ListB=divide_2.Points, CrossMode=1)  # -> ListA, ListB
list = ValueList({"Shortest List": "0", "Longest List": "1", "Cross Match": "2"}, selected="Shortest List")
ln = Line(StartPoint=crossref.ListA, EndPoint=crossref.ListB)
ln_2 = Line(StartPoint=long.ListA, EndPoint=long.ListB)
ln_3 = Line(StartPoint=short.ListA, EndPoint=short.ListB)
panel_3 = Panel("Item(s)")
filter = StreamFilter(Gate=list, Stream0=ln_3, Stream1=ln_2, Stream2=ln)
