# Grasshopper definition 00_02_Lists_Advanced.gh (Grasshopper 0.9.76)

# ---- group: List
txt = Text(["New York City", "Seattle", "San Francisco", "Chicago", "Los Angeles", "Boston"])

# ----
wrap = BooleanToggle(False)
shift = ShiftList(List=txt, Shift=Slider(0, range=-2..2), Wrap=wrap)
item = ListItem(List=txt, Index=Slider(2, range=0..5), Wrap=True)
lng = ListLength(List=txt)
rev = ReverseList(List=txt)
list = Panel(txt)
list_length = Panel(lng)
list_item = Panel(item)
reverse_list = Panel(rev)
shift_list = Panel(shift)
dom = ConstructDomain(DomainStart=Slider(0, range=0..6), DomainEnd=Slider(6, range=0..6))
ins = InsertItems(List=txt, Item="Brooklyn", Indices=Slider(0, range=0..6), Wrap=True)
subset = SubList(List=txt, Domain=dom, Wrap=True)  # -> List, Index
split = SplitList(List=txt, Index=Slider(3, range=0..6))  # -> ListA, ListB
insert_item = Panel(ins)
list_a = Panel(split.ListA)
sub_list = Panel(subset.List)
list_b = Panel(split.ListB)
