# Grasshopper definition 00_03_Data Trees_Intro.gh (Grasshopper 0.9.76)

numy = Slider(8, range=1..20)
numx = Slider(6, range=1..20)
Y = Slider(2, range=0..5)
# Data Trees
# -
# 1. As of Grasshopper 0.6, data can be stored in hierarchical structures similar to a branching tree.
# 
# 2. Data is still stored in lists, but each list now has a ‘path’
# 
# 3. 'Paths' are a series of indices describing the position of the data branch inside the tree.
# --
# *** This allows us to move through an ordered collection of entities in a Tree "Laterally" as well as "Vertically" relative to the organization of the Data Tree.
X = Slider(2, range=0..5)
series = Series(Start=0, Step=X, Count=numx)
series_2 = Series(Start=0, Step=Y, Count=numy)
graft = GraftTree(Data=series, IncludeEmptyLists=True, IncludeNullItems=True)
pt = ConstructPoint(XComponent=graft, YComponent=series_2, ZComponent=0)  # -> simplify(Point)
a_data_tree_of_points = Panel(pt)

# ---- group: Visualize Data Tree | Path
pt_2 = Point(simplify(graft(pt)))
tstat = TreeStatistics(Tree=pt_2)  # -> Paths, Length, Count
number_slider = Slider(0.4, range=0..10)
unflatten = UnflattenTree(Tree=tstat.Paths, Guide=pt_2)
panel = Panel(tstat.Paths)

# ---- group: Data Tree Structure
panel_2 = Panel("Index")
trunk = Panel(pt)
panel_3 = Panel("Item")
# Final Path Structure: The number of Paths corresponds to the number of Points specified in the X Direction
# 
# Each Path contains a List of Points corresponding to the number specified in the Y Direction
panel_4 = Panel("Data Path")
viewer = ParamViewer(trunk)

# ---- group: Graft Points
pt_3 = Point(graft(pt))

# ----
tstat_2 = TreeStatistics(Tree=pt_3)  # -> Paths, Length, Count
panel_5 = Panel(tstat_2.Paths)

# ---- group: Which Branch to Retrieve
item = ListItem(List=tstat_2.Paths, Index=Slider(8, range=0..47), Wrap=True)

# ---- group: Visualize Data Tree | Path / Path
tag = TextTag3D(Location=pt_2, Text=unflatten, Size=number_slider, Justification=7)

# ---- group: Retrieves That Branch
branch = TreeBranch(Tree=pt_3, Path=item, MaintainPaths=True)
