# Grasshopper definition 00_04_Data Trees_Manipuation.gh (Grasshopper 0.9.76)
# Creative Commons License 
# [http://creativecommons.org/licenses/by-nc-nd/3.0/us/]
# 
# Grasshopper Workshop Curriculum + Files 
# by Studio Mode, LLC [studiomode.nu]
# is licensed under a Creative Commons Attribution-Noncommercial-No Derivative Works 3.0 United States License [http://creativecommons.org/licenses/by-nc-nd/3.0/us/]

# ---- group: Z
numz = Slider(7, range=1..20)
series = Series(Start=0, Step=1, Count=numz)
Z = UnitZ(Factor=series)

# ---- group: X
numx = Slider(8, range=1..20)
series_2 = Series(Start=0, Step=1, Count=numx)
X = UnitX(Factor=series_2)

# ---- group: Y
numy = Slider(4, range=1..20)
series_3 = Series(Start=0, Step=1, Count=numy)
Y = UnitY(Factor=series_3)

# ---- group: Start Point
# Manipulating Data Trees
# -
# The basic set of manipulations for Data Trees change the structure "along" the path.
X_2 = Slider(1.471, range=0..5)
Y_2 = Slider(1.193, range=0..5)
pt = ConstructPoint(XCoordinate=X_2, YCoordinate=Y_2, ZCoordinate=0)

# ----
move = Move(Geometry=pt, Motion=X)  # -> Geometry, Transform
# Graft: Grafting creates a new branch for every single data item.
graft = GraftTree(Data=move.Geometry, IncludeEmptyLists=True, IncludeNullItems=True)
move_2 = Move(Geometry=graft, Motion=Y)  # -> Geometry, Transform
graft_2 = GraftTree(Data=move_2.Geometry, IncludeEmptyLists=True, IncludeNullItems=True)
move_3 = Move(Geometry=graft_2, Motion=Z)  # -> Geometry, Transform

# ---- group: Final Points
pt_2 = Point(move_3.Geometry)

# ---- group: Point List Display
font = Slider(0.3, range=0.1..1)
toggle = BooleanToggle(True)
xpoints = PointList(Points=pt_2, Tags=toggle, Lines=toggle, Size=font)

# ---- group: Double-Click to View Diagram
viewer = ParamViewer(pt_2)

# ----
graft_3 = GraftTree(Data=pt_2, IncludeEmptyLists=True, IncludeNullItems=True)

# ---- group: Shift Path
pshift = ShiftPaths(Data=pt_2, Offset="-1")

# ----
viewer_2 = ParamViewer(graft_3)
simplify = SimplifyTree(Tree=pt_2, Front=False)
# Graft: Grafting creates a new branch for every single data item.
# Shift Paths: Shift (thereby removing Path Levels) of a tree based on an Offset value.
viewer_3 = ParamViewer(pshift)
viewer_4 = ParamViewer(simplify)
flatten = FlattenTree(Data=pt_2, Path="{0}")
# Simplify: Simplify a tree by removing the overlap shared amongst all branches.
# Flatten: The Flatten Component removes all branch information from a data tree.
viewer_5 = ParamViewer(flatten)
