# Grasshopper definition 00_05_Data Trees_Lexical Mapping.gh (Grasshopper 0.9.76)

# ----
# Path Mapper
# -
# Perform lexical operations on data trees:
# -
# Lexical operations are logical mappings between data paths and indices which are defined by textual (lexical) masks and patterns.
# Series: Creates a set of discreet numbers based on a start value, step size, and the number of values in the series.
paths = Slider(4, range=2..10)
items = Slider(3, range=2..10)
series = Series(Start=0, Step="0", Count=paths)
series_2 = Series(Start=series, Step="1", Count=items)

# ---- group: Right-Click "Null Mapping": This will reveal the 'book-keeping' of the Data Tree.
path_mapper = PathMapper(series_2, source="{A;B;C}", target="{A;B;C}")

# ---- group: Re-mapping the Path Index and the desired Branch you can modify a Data Tree.
path_mapper_2 = PathMapper(series_2, source="{A;B;C}(i)", target="{A;B;i}(C)")

# ---- group: Re-Composed Path Structure
viewer = ParamViewer(path_mapper_2)

# ---- group: Existing Data Structure
viewer_2 = ParamViewer(path_mapper)
panel = Panel(path_mapper)
