# Grasshopper definition 00_06_Data Trees_Flip Matrix.gh (Grasshopper 0.9.76)

u = Slider(32, range=1..40)
v = Slider(11, range=1..40)

# ---- group: Referenced Surface
# Data Trees
# 
# Flip Matrix
# -
# Points organized in two dimensions can exist in XY -or- UV space.
# Objects stored in a two dimensional Data Tree can be "Flipped" thereby reorganizing them based on a new Primary "Direction"
srf = Surface(reparameterize(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))

# ---- group: Surface Divide
sdivide = DivideSurface(Surface=srf, UCount=u, VCount=v)  # -> Points, Normals, Parameters

# ---- group: World Points
pt = Point(sdivide.Points)

# ---- group: Flip Matrix
# Flips a Data Matrix  (2D Data Tree) by swapping “Rows” and “Columns.”
flip = FlipMatrix(Data=pt)

# ----
minmove = Slider(0, range=0..1)
maxmove = Slider(1.373, range=0..4)

expression = Expression(x=<missing>, Expression="Round(x,2)")
tag = TextTag3D(Location=pt, Text=expression, Size=Slider(0.276, range=0..1), Justification=7)

bnd = Bounds(Numbers=flatten(<missing>))
dom = Domain(DomainStart=minmove, DomainEnd=maxmove)

# ---- group: Filter Orig or Flipped Data Tree
filter = StreamFilter(Gate=Toggle(False), Stream0=flip, Stream1=pt)

# ----
remap = RemapNumbers(Value=<missing>, Source=bnd, Target=dom)  # -> Result, Clipped

# ---- group: Z Vector
Z = UnitZ(Factor=remap.Result)

# ---- group: Translate Points
addition = Addition(A=filter, B=Z)

# ---- group: Offset Curves
crv = Curve(Vertices=addition, Degree=3, Periodic=False)  # -> Curve, Length, Domain
