# Grasshopper definition 00_07_Data Trees_Building Panels.gh (Grasshopper 0.9.76)
# Copyright: Mode Lab

# ---- group: Building Massing
brep = Brep(simplify(graft([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])))

# ---- group: Extract Faces
debrep = DeconstructBrep(Brep=brep)  # -> simplify(Faces), Edges, Vertices

# ----
graft = GraftTree(Tree=debrep.Faces, IncludeEmptyLists=True, IncludeNullItems=True)

# ---- group: Visualize Building Panels
divide = DivideDomain²(Domain=graft, UCount=10, VCount=10)
subsrf = Isotrim(Surface=graft, Domain=divide)
edges = BrepEdges(Brep=subsrf)  # -> Naked, Interior, NonManifold
preview = CustomPreview(Geometry=subsrf, Shader=ColourSwatch(SwatchColor=RGB(128, 116, 116)))
preview_2 = CustomPreview(Geometry=edges.Naked, Shader=ColourSwatch(SwatchColor=RGB(48, 48, 48)))

# ---- group: Subdivide Faces into Point Grids
sdivide = DivideSurface(Surface=graft, UCount=10, VCount=10)  # -> simplify(Points), Normals, Parameters

# ----
graft_2 = GraftTree(Tree=sdivide.Points, IncludeEmptyLists=True, IncludeNullItems=True)
flatten = FlattenTree(Tree=graft_2, Path="{0}")
tstat = TreeStatistics(Tree=graft_2)  # -> Paths, Length, Count

# ---- group: Label each Panel with Location
tag = TextTag3D(
    Location=flatten,
    Text=tstat.Paths,
    Size=Slider(2.6, range=0..10),
    Colour=ColourSwatch(SwatchColor=RGB(255, 255, 255)),
    Justification=7)

# ---- group: {Building; Face; Column; Row}
panel = Panel(graft_2)
