# Grasshopper definition 00_08_Workflows.gh (Grasshopper 0.9.76)

# ---- group: Group Annotation
# Improving Your Parametric Workflow: This file describes several methods to improve your efficiency within the grasshopper environment. Using annotations, notes, descriptions, groups and lines, visually design your definition so that clarity is emphasized and your logic is accessible to a third party. This becomes increasingly critical when working in collaborative environments.
# Grouping: Right click on Group, annotation group + change color
# 
# extremely useful for organizing and annotating definitions
# Panel Title: Panels - Right click or Zoom in for additional options
# Can change color, alignment, font, font size and other things.
grouping = Panel("Control + G: Group")

# ----
# Keyboard Shortcuts: Alt + Mouse Drag: "Moses" movement on canvas
# +hit alt again to toggle horizontal
# --
# Alt + Control + Left Click on component to reveal which tab it came from
# --
# Alt + Tab to switch to another open definition
# --
# Control + Q : Toggle Display
# Control + E : Toggle Enabled
# Cluster: Creates Cluster of components - useful for consolidating definitions + sharing files
# 
# Edit -> Cluster
input = ClusterInput()

# ---- group: Right Click - Internalise Data
# Additional Panel Options on Right Click:
# -Multiline Data
# -Wrap Items
# -Draw Indices
# -Draw Paths
# Additional Panel Options on Right Click:
# -Multiline Data
# -Wrap Items
# -Draw Indices
# -Draw Paths
# Parameter Components: On Parameter components:
# --
# Right click, set "Internalise Data" - internalises rhino geometry so if you open this grasshopper file on a file that does not have the geometry, it doesn't give you an error.
# 
# --
# 
# NEW For a Point component that has internalised a point: Select the point component. In Rhino, a gumball appears. This is useful when working with attractor patterns.
# Draw on GH Canvas: On Grasshopper Canvas Toolbar:
# --
# Draw on Canvas. Right Click. Select "Send to Rhino". Adjust geometry in Rhino. Right click on line in GH, select "Load From Rhino"
# --
# Useful for adding annotations, etc.
# Display -> Canvas Widgets
# --
# Align - Group select to activate align icons
# --
# Markov - bottom right of canvas, AI tries to predict your next component
# --
# Profiler - Displays what % of calculation each particular component is using. Very useful for troubleshooting.
# --
# Compass - bottom right of canvas, displays location of nearby components
pt = Point(Point(-51.99281037, -21.61615715, 14.0444331))

# ----
# Remote Control Panel: Right click slider "Publish to Remote Control Panel"
# --
# View - Remote Control Panel
srf = Surface(reparameterize(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))

# ----
# Cluster: This cluster is of 07 - Flip Matrix.gh
# --
# Input Surface, Output final curves
cluster = Cluster(S=srf)

output = ClusterOutput()
crv = Curve(cluster)
recgrid = Rectangular(
    Plane=PlaneXY(0, 0, 0),
    SizeX=Slider(6, range=0..25),
    SizeY=Slider(11, range=0..25),
    ExtentX=Slider(6, range=0..25),
    ExtentY=Slider(8, range=0..25))  # -> Cells, Points

# ==== cluster Cluster
u = Slider(32, range=1..40)
v = Slider(11, range=1..40)
S = ClusterInput()

# ---- group: Surface Divide
sdivide = DivideSurface(Surface=S, UCount=u, VCount=v)  # -> Points, Normals, Parameters

# ---- group: World Points
pt = Point(sdivide.Points)

# ---- group: Sample an Image
image = ImageSampler(sdivide.Parameters, Filter="Value", Interpolate=True, Umax=1, Umin=0, Vmax=1, Vmin=0, Wrap=1)

# ---- group: Flip Matrix
# Flips a Data Matrix  (2D Data Tree) by swapping “Rows” and “Columns.”
flip = FlipMatrix(Data=pt)

# ----
minmove = Slider(0, range=0..1)
maxmove = Slider(1.373, range=0..4)

expression = Expression(x=image, Expression="Round(x,2)")
tag = TextTag3D(Location=pt, Text=expression, Size=Slider(0.276, range=0..1), Justification=7)

bnd = Bounds(Numbers=flatten(image))
dom = Domain(DomainStart=minmove, DomainEnd=maxmove)

# ---- group: Filter Orig or Flipped Data Tree
filter = StreamFilter(Gate=Toggle(False), Stream0=flip, Stream1=pt)

# ----
remap = RemapNumbers(Value=image, Source=bnd, Target=dom)  # -> Result, Clipped

# ---- group: Z Vector
Z = UnitZ(Factor=remap.Result)

# ---- group: Translate Points
addition = Addition(A=filter, B=Z)

# ---- group: Offset Curves
crv = Curve(Vertices=addition, Degree=3, Periodic=False)  # -> Curve, Length, Domain

# ----
C = ClusterOutput(crv.Curve)
