# Grasshopper definition 03_01_DF_Para Srf_2015.02.14.gh (Grasshopper 0.9.76)

panel = Panel("Notes:")

# ---- group: EX 01 / INPUT
# Create Surface from Curves using Loft Component
# 
# Use Series to Create multiple Curves and Graph Mapper to create Variation
pt = Point(<point referenced from the Rhino model>)

# ---- group: EX 01
series = Series(Start=0, Step=Slider(6.8, range=0..20), Count=Slider(6, range=0..20))
Z = UnitZ(Factor=series)
graph = GraphMapper(series, x0=0, x1=1, y0=10, y1=20, container_name="Sine", Equation_px=[0, 0.5], Equation_py=[0, 1])
circle = CircleCNR(Center=pt, Normal=Vector(0, 0, 1), Radius=graph)
move = Move(Geometry=circle, Motion=Z)  # -> Geometry, Transform
loft = Loft(Curves=move.Geometry, Options={Adjust=False, Closed=False, LoftEnds=0, LoftSimp=0, LoftType=0, Rebuild=10, Refit=0.01})

# ---- group: EX 00 / INPUT
# Create Surface from Curves using Loft Component
crv01 = Curve(<curve referenced from the Rhino model>)
crv02 = Curve(<curve referenced from the Rhino model>)
crv03 = Curve(<curve referenced from the Rhino model>)

# ---- group: EX 03 / INPUT
crv = Curve(<curve referenced from the Rhino model>)
# Create Surface from Parametric Interpolate Curves using Edge Srf Component
# 
# The Curves defining the Surface are Parametric, which will change the srf based on the parameters set for the Curves
crv_2 = Curve(<curve referenced from the Rhino model>)
crv_3 = Curve(<curve referenced from the Rhino model>)
crv_4 = Curve(<curve referenced from the Rhino model>)

# ---- group: EX 03
slider = Slider(15, range=0..50)
slider_2 = Slider(15, range=0..50)
end = EndPoints(Curve=crv)  # -> Start, End
end_2 = EndPoints(Curve=crv_2)  # -> Start, End
end_3 = EndPoints(Curve=crv_3)  # -> Start, End
end_4 = EndPoints(Curve=crv_4)  # -> Start, End
curvepoint = PointOnCurve(crv, parameter=0.5)
curvepoint_2 = PointOnCurve(crv_2, parameter=0.5)
curvepoint_3 = PointOnCurve(crv_3, parameter=0.5)
curvepoint_4 = PointOnCurve(crv_4, parameter=0.5)
pdecon = Deconstruct(Point=curvepoint_2)  # -> XComponent, YComponent, ZComponent
pdecon_2 = Deconstruct(Point=curvepoint)  # -> XComponent, YComponent, ZComponent
pdecon_3 = Deconstruct(Point=curvepoint_4)  # -> XComponent, YComponent, ZComponent
pdecon_4 = Deconstruct(Point=curvepoint_3)  # -> XComponent, YComponent, ZComponent
addition = Addition(A=pdecon.ZComponent, B=slider)
addition_2 = Addition(A=pdecon_2.ZComponent, B=slider_2)
addition_3 = Addition(A=pdecon_3.ZComponent, B=slider)
addition_4 = Addition(A=pdecon_4.ZComponent, B=slider_2)
pt_2 = ConstructPoint(XCoordinate=pdecon.XComponent, YCoordinate=pdecon.YComponent, ZCoordinate=addition)
pt_3 = ConstructPoint(XCoordinate=pdecon_2.XComponent, YCoordinate=pdecon_2.YComponent, ZCoordinate=addition_2)
pt_4 = ConstructPoint(XCoordinate=pdecon_3.XComponent, YCoordinate=pdecon_3.YComponent, ZCoordinate=addition_3)
pt_5 = ConstructPoint(XCoordinate=pdecon_4.XComponent, YCoordinate=pdecon_4.YComponent, ZCoordinate=addition_4)
intcrv = Interpolate(Vertices=[end_2.Start, pt_2, end_2.End], Degree=3, Periodic=False, KnotStyle=1)  # -> Curve, Length, Domain
intcrv_2 = Interpolate(Vertices=[end.Start, pt_3, end.End], Degree=3, Periodic=False, KnotStyle=1)  # -> Curve, Length, Domain
intcrv_3 = Interpolate(Vertices=[end_4.Start, pt_4, end_4.End], Degree=3, Periodic=False, KnotStyle=1)  # -> Curve, Length, Domain
intcrv_4 = Interpolate(Vertices=[end_3.Start, pt_5, end_3.End], Degree=3, Periodic=False, KnotStyle=1)  # -> Curve, Length, Domain
edgesrf = EdgeSurface(CurveA=intcrv.Curve, CurveB=intcrv_2.Curve, CurveC=intcrv_3.Curve, CurveD=intcrv_4.Curve)

# ---- group: EX 00
loft_2 = Loft(
    Curves=[crv01, crv02, crv03],
    Options={Adjust=False, Closed=False, LoftEnds=0, LoftSimp=0, LoftType=0, Rebuild=10, Refit=0.01})
