# Grasshopper definition 03_02_DF_Para Srf_Div_Pop_2015.02.14.gh (Grasshopper 0.9.76)

panel = Panel("Notes:")

# ---- group: EX 01 / INPUT
# Create Surface from Curves using Loft Component
# 
# Use Series to Create multiple Curves and Graph Mapper to create Variation
pt = Point(<point referenced from the Rhino model>)

# ---- group: EX 01
series = Series(Start=0, Step=Slider(6.8, range=0..20), Count=Slider(6, range=0..20))
Z = UnitZ(Factor=series)
graph = GraphMapper(series, x0=0, x1=1, y0=10, y1=20, container_name="Sine", Equation_px=[0, 0.5], Equation_py=[0, 1])
circle = CircleCNR(Center=pt, Normal=Vector(0, 0, 1), Radius=graph)
move = Move(Geometry=circle, Motion=Z)  # -> Geometry, Transform
loft = Loft(Curves=move.Geometry, Options={Adjust=False, Closed=False, LoftEnds=0, LoftSimp=0, LoftType=0, Rebuild=10, Refit=0.01})

# ---- group: EX 00 / INPUT
# Create Surface from Curves using Loft Component
crv02 = Curve(<curve referenced from the Rhino model>)
crv03 = Curve(<curve referenced from the Rhino model>)

# ---- group: EX 03 / INPUT
crv = Curve(<curve referenced from the Rhino model>)
# Create Surface from Parametric Interpolate Curves using Edge Srf Component
# 
# The Curves defining the Surface are Parametric, which will change the srf based on the parameters set for the Curves
crv_2 = Curve(<curve referenced from the Rhino model>)
crv_3 = Curve(<curve referenced from the Rhino model>)
crv_4 = Curve(<curve referenced from the Rhino model>)

# ---- group: EX 03
slider = Slider(15, range=0..50)
slider_2 = Slider(15, range=0..50)
end = EndPoints(Curve=crv)  # -> Start, End
end_2 = EndPoints(Curve=crv_2)  # -> Start, End
end_3 = EndPoints(Curve=crv_3)  # -> Start, End
end_4 = EndPoints(Curve=crv_4)  # -> Start, End
curvepoint = PointOnCurve(crv, parameter=0.5)
curvepoint_2 = PointOnCurve(crv_2, parameter=0.5)
curvepoint_3 = PointOnCurve(crv_3, parameter=0.5)
curvepoint_4 = PointOnCurve(crv_4, parameter=0.5)
pdecon = Deconstruct(Point=curvepoint_2)  # -> XComponent, YComponent, ZComponent
pdecon_2 = Deconstruct(Point=curvepoint)  # -> XComponent, YComponent, ZComponent
pdecon_3 = Deconstruct(Point=curvepoint_4)  # -> XComponent, YComponent, ZComponent
pdecon_4 = Deconstruct(Point=curvepoint_3)  # -> XComponent, YComponent, ZComponent
addition = Addition(A=pdecon.ZComponent, B=slider)
addition_2 = Addition(A=pdecon_2.ZComponent, B=slider_2)
addition_3 = Addition(A=pdecon_3.ZComponent, B=slider)
addition_4 = Addition(A=pdecon_4.ZComponent, B=slider_2)
pt_2 = ConstructPoint(XCoordinate=pdecon.XComponent, YCoordinate=pdecon.YComponent, ZCoordinate=addition)
pt_3 = ConstructPoint(XCoordinate=pdecon_2.XComponent, YCoordinate=pdecon_2.YComponent, ZCoordinate=addition_2)
pt_4 = ConstructPoint(XCoordinate=pdecon_3.XComponent, YCoordinate=pdecon_3.YComponent, ZCoordinate=addition_3)
pt_5 = ConstructPoint(XCoordinate=pdecon_4.XComponent, YCoordinate=pdecon_4.YComponent, ZCoordinate=addition_4)
intcrv = Interpolate(Vertices=[end_2.Start, pt_2, end_2.End], Degree=3, Periodic=False, KnotStyle=1)  # -> Curve, Length, Domain
intcrv_2 = Interpolate(Vertices=[end.Start, pt_3, end.End], Degree=3, Periodic=False, KnotStyle=1)  # -> Curve, Length, Domain
intcrv_3 = Interpolate(Vertices=[end_4.Start, pt_4, end_4.End], Degree=3, Periodic=False, KnotStyle=1)  # -> Curve, Length, Domain
intcrv_4 = Interpolate(Vertices=[end_3.Start, pt_5, end_3.End], Degree=3, Periodic=False, KnotStyle=1)  # -> Curve, Length, Domain
edgesrf = EdgeSurface(CurveA=intcrv.Curve, CurveB=intcrv_2.Curve, CurveC=intcrv_3.Curve, CurveD=intcrv_4.Curve)

# ---- group: EX 00
loft_2 = Loft(Curves=[crv02, crv03], Options={Adjust=False, Closed=False, LoftEnds=0, LoftSimp=0, LoftType=0, Rebuild=10, Refit=0.01})

# ----
# Surface Division and Population methods
saddle_srf = Surface(edgesrf)

# ----
# COLOR APPLICATION TO SURFACE GEOMETRY
# - DATA MANAGMENT
# - MATH
# - CONVERSION OF DATA
# - USING ATTRACTORS DEFINITION
# SWAP OUT THE SAMPLE SURFACE FOR THE TOWER SURFACE GEOMETRY THAT WE POPULATED IN ORDER TO APPLY COLOR TO THE MODULES BASED ON ATTRACTOR POINTS
crv_01 = Curve()
crv_02 = Curve()
loft_3 = Loft(
    Curves=[crv_01, crv_02],
    Options={Adjust=False, Closed=False, LoftEnds=0, LoftSimp=0, LoftType=0, Rebuild=10, Refit=0.01})
divide = DivideDomain²(Domain=loft_3, UCount=Slider(8, range=0..10), VCount=Slider(5, range=0..10))
subsrf = Isotrim(Surface=loft_3, Domain=divide)

# ---- group: EGG CRATE / INPUT
srf = Surface()

# ---- group: EGG CRATE
slider_3 = Slider(20, range=0..100)
divide_2 = DivideDomain²(Domain=srf, UCount=slider_3, VCount=slider_3)
subsrf_2 = Isotrim(Surface=srf, Domain=divide_2)
explode = BrepComponents(Brep=subsrf_2)  # -> Faces, Edges, Vertices
item = ListItem(List=explode.Edges, Index=0, Wrap=True)
item_2 = ListItem(List=explode.Edges, Index=1, Wrap=True)
item_3 = ListItem(List=explode.Edges, Index=2, Wrap=True)
item_4 = ListItem(List=explode.Edges, Index=3, Wrap=True)
join = JoinCurves(Curves=item, Preserve=False)
join_2 = JoinCurves(Curves=item_2, Preserve=False)
Z_2 = UnitZ(Factor=1)
extr = Extrude(Base=[join, join_2], Direction=Z_2)

# ---- group: 2D NATIVE GEO ABOUT SRF / INPUT
srf_2 = Surface()

# ---- group: DIAGRID / INPUT
srf_3 = Surface()

# ---- group: 3D NATIVE GEO ABOUT SRF / INPUT
srf_4 = Surface()

# ---- group: 3D NATIVE GEO ABOUT SRF
slider_4 = Slider(10, range=0..100)
divide_3 = DivideDomain²(Domain=srf_4, UCount=slider_4, VCount=slider_4)
subsrf_3 = Isotrim(Surface=srf_4, Domain=divide_3)
explode_2 = BrepComponents(Brep=subsrf_3)  # -> Faces, Edges, Vertices
item_5 = ListItem(List=explode_2.Vertices, Index=0, Wrap=True)
item_6 = ListItem(List=explode_2.Vertices, Index=1, Wrap=True)
item_7 = ListItem(List=explode_2.Vertices, Index=2, Wrap=True)
item_8 = ListItem(List=explode_2.Vertices, Index=3, Wrap=True)
slider_5 = Slider(0.5, range=0..1)
crv_5 = Curve(Vertices=[item_5, item_6, item_7, item_8], Degree=3, Periodic=Toggle(True))  # -> Curve, Length, Domain
area = Area(Geometry=explode_2.Faces)  # -> Area, Centroid
pt_6 = ConstructPoint(XCoordinate=slider_5, YCoordinate=slider_5, ZCoordinate=0)
scale = Scale(Geometry=crv_5.Curve, Center=area.Centroid, Factor=0.5)  # -> Geometry, Transform
eval = EvaluateSurface(Surface=reparameterize(explode_2.Faces), Point=pt_6)  # -> Point, Normal, Frame
amp = Amplitude(Vector=eval.Normal, Amplitude=Slider(2, range=0..100))
move_2 = Move(Geometry=scale.Geometry, Motion=amp)  # -> Geometry, Transform
loft_4 = Loft(
    Curves=[crv_5.Curve, move_2.Geometry],
    Options={Adjust=False, Closed=False, LoftEnds=0, LoftSimp=0, LoftType=0, Rebuild=10, Refit=0.01})

# ---- group: DIAGRID
u_value = Slider(15, range=0..30)
v_value = Slider(15, range=0..30)
divide_4 = DivideDomain²(Domain=srf_3, UCount=u_value, VCount=v_value)
subsrf_4 = Isotrim(Surface=srf_3, Domain=divide_4)
explode_3 = BrepComponents(Brep=subsrf_4)  # -> Faces, Edges, Vertices
item_9 = ListItem(List=explode_3.Vertices, Index=0, Wrap=True)
item_10 = ListItem(List=explode_3.Vertices, Index=1, Wrap=True)
item_11 = ListItem(List=explode_3.Vertices, Index=2, Wrap=True)
item_12 = ListItem(List=explode_3.Vertices, Index=3, Wrap=True)
ln = Line(StartPoint=item_9, EndPoint=item_11)
ln_2 = Line(StartPoint=item_10, EndPoint=item_12)
pipe_rad = Slider(0.15, range=0..1)
pipe = Pipe(Curve=[ln, ln_2], Radius=pipe_rad, Caps=0)

# ----
attractor_points = Point([<point referenced from the Rhino model> x2])
area_2 = Area(Geometry=subsrf)  # -> Area, Centroid
cp = ClosestPoint(Point=area_2.Centroid, Set=attractor_points)  # -> ClosestPoint, CPIndex, Distance
dist = Distance(PointA=cp.ClosestPoint, PointB=area_2.Centroid)
ln_3 = Line(PointA=area_2.Centroid, PointB=cp.ClosestPoint)
division = Division(A=dist, B=Slider(50, range=0..5000))
min = Minimum(A=division, B=Slider(1, range=0..4))
gradient = Gradient(LowerLimit=0, UpperLimit=1, Parameter=min, stops=[0: RGB(255, 130, 160), 1: RGB(220, 0, 40)])
gradient_2 = Gradient(
    LowerLimit=0,
    UpperLimit=1,
    Parameter=min,
    stops=[0: RGB(243, 57, 0), 0.1: RGB(236, 27, 60), 0.2: RGB(210, 0, 118), 0.3: RGB(103, 0, 120), 0.4: RGB(39, 72, 161), 0.5: RGB(1, 192, 229), 0.6: RGB(18, 178, 90), 0.7: RGB(79, 186, 8), 0.8: RGB(220, 237, 32), 0.9: RGB(247, 159, 20), 1: RGB(243, 57, 0)])
panel_8 = Panel(min)
brep = Brep(subsrf)
material = CreateMaterial(Diffuse=gradient_2, Specular=RGB(255, 255, 255), Emission=RGB(0, 0, 0), Transparency=0, Shine=0)
vb = VBScript(blnBake=Toggle(False), obj=brep, color=gradient_2, layer="color output_tower")  # -> out, A, type
# ---------- vb: VB ----------
    If blnBake Then

      Dim att As New Rhino.DocObjects.ObjectAttributes()
      Dim t As String
      att.ColorSource = Rhino.DocObjects.ObjectColorSource.ColorFromObject
      att.ObjectColor = color

      If String.IsNullOrEmpty(layer) Then
        att.LayerIndex = doc.Layers.CurrentLayerIndex

      Else

        Dim layer_index As Integer = doc.Layers.Find(layer, True)
        If layer_index >= 0 Then
          att.LayerIndex = layer_index

        Else
          layer_index = doc.Layers.Add(layer, System.Drawing.Color.Black)
          att.LayerIndex = layer_index

        End If

      End If

      'If TypeOf obj Is Brep Then
      Dim mObj As Guid
      mObj = doc.Objects.AddBRep(obj, att)
      t = "BRep"
      type = t
      'End If

    End If
# ---------- end vb ----------
preview = CustomPreview(Geometry=brep, Shader=material)

# ---- group: 2D NATIVE GEO ABOUT SRF
slider_6 = Slider(10, range=0..100)
divide_5 = DivideDomain²(Domain=srf_2, UCount=slider_6, VCount=slider_6)
subsrf_5 = Isotrim(Surface=srf_2, Domain=divide_5)
explode_4 = BrepComponents(Brep=subsrf_5)  # -> Faces, Edges, Vertices
item_13 = ListItem(List=explode_4.Vertices, Index=0, Wrap=True)
item_14 = ListItem(List=explode_4.Vertices, Index=1, Wrap=True)
item_15 = ListItem(List=explode_4.Vertices, Index=2, Wrap=True)
item_16 = ListItem(List=explode_4.Vertices, Index=3, Wrap=True)
crv_6 = Curve(Vertices=[item_13, item_14, item_15, item_16], Degree=3, Periodic=Toggle(False))  # -> Curve, Length, Domain

# ---- group: 3D NON-NATIVE GEO ABOUT SRF / INPUT SRF
srf_5 = Surface()

# ---- group: 3D NON-NATIVE GEO ABOUT SRF / INPUT RHINO GEO
# Reference Module in Rhino File
# 
# Right click and reference it here in order to populate it on to the surface that has been created.
brep_2 = Brep()

# ---- group: 3D NON-NATIVE GEO ABOUT SRF
u_value_2 = Slider(15, range=0..20)
v_value_2 = Slider(15, range=0..20)
divide_6 = DivideDomain²(Domain=srf_5, UCount=u_value_2, VCount=v_value_2)
bbox = BoundingBox(Content=brep_2, Plane=PlaneXY(0, 0, 0))  # -> Box, Box_2
sbox = SurfaceBox(Surface=srf_5, Domain=divide_6, Height=1)
morph = BoxMorph(Geometry=brep_2, Reference=bbox.Box, Target=sbox)

# ---- group: ATTRACTOR SCALING
# Attch the vaules from the attractors to the height input on the surface box component
# Set attractor points
# 
# Right click and set one pt.
# Connect vaulues into the 'H' - height input of the surface box component in order to scale the surface geomerty locally based on attractor points.
subsrf_6 = Isotrim()
area_3 = Area(Geometry=subsrf_6)  # -> Area, Centroid
pt_01 = Point(<point referenced from the Rhino model>)
pt_02 = Point(<point referenced from the Rhino model>)
cp_2 = ClosestPoint(Point=area_3.Centroid, Set=[pt_01, pt_02])  # -> ClosestPoint, CPIndex, Distance
amount_of_scaling = Slider(10, range=0..2000)
maximum_scale_size = Slider(4.6, range=0..20)
ln_4 = Line(PointA=cp_2.ClosestPoint, PointB=area_3.Centroid)
dist_2 = Distance(PointA=cp_2.ClosestPoint, PointB=area_3.Centroid)
division_2 = Division(A=dist_2, B=amount_of_scaling)
min_2 = Minimum(A=division_2, B=maximum_scale_size)
values_from_the_attractors = Data(min_2)
