# Grasshopper definition DF_StructuresWorkshop_EX1_20150221.gh (Grasshopper 0.9.76)
# plug-ins: LunchBox, Millipede

# ---- group: I Beam Inputs (Meters)
number_slider = Slider(0.25, range=0.1..0.5)
number_slider_2 = Slider(0.75, range=0.1..1)
flange_thickness = Slider(0.015, range=0.01..0.1)

# ---- group: Pipe Inputs (Meters)
number_slider_3 = Slider(0.1, range=0.1..0.5)
flange_thickness_2 = Slider(0.01, range=0.01..0.1)

# ----
# 1) Generate Truss with Lunchbox
number_slider_4 = Slider(11, range=5..25)
number_slider_5 = Slider(11, range=5..25)
truss_depth = Slider(2.5, range=1..5)

area_load_in_n_m2 = Slider(0, range=0..3000)

# ---- group: RH_LoadingBrep
brep = Brep(<brep referenced from the Rhino model>)

# ---- group: RH_InputCurves
# Example 1
# Long Span Space Frame with Millipede Analysis
crv = Curve([<curve referenced from the Rhino model> x3])

# ---- group: Define Material
mat = Material(MaterialType=2)

# ---- group: Load shells within Brep
multiplication = Multiplication(A=area_load_in_n_m2, B="-1")
Z = UnitZ(Factor=multiplication)
load_region = LoadRegion(Boundary=brep, AreaLoad=Z)

# ---- group: Loft input crvs and generate Spaceframe
loft = Loft(Curves=crv, Options={Adjust=False, Closed=False, LoftEnds=0, LoftSimp=0, LoftType=0, Rebuild=10, Refit=0.01})
multiplication_2 = Multiplication(A=truss_depth, B="-1")
spacetruss_1 = SpaceTrussStructure1(Surface=loft, UDivisions=number_slider_4, VDivisions=number_slider_5, TrussDepth=multiplication_2)  # -> LinesA, LinesB, Web, Nodes
mesh_uv = MeshSurface(Surface=loft, UCount=number_slider_4, VCount=number_slider_5, Overhang=True, Equalize=False)

# ---- group: Find nodes at edges
panel = Panel("""0
2""")
item = ListItem(List=crv, Index=panel, Wrap=True)
pull = PullPoint(Point=spacetruss_1.Nodes, Geometry=item, ClosestOnly=True)  # -> ClosestPoint, Distance
smaller = SmallerThan(FirstNumber=pull.Distance, SecondNumber=".001")  # -> SmallerThan, OrEqualTo
dispatch = Dispatch(List=spacetruss_1.Nodes, DispatchPattern=smaller.SmallerThan)  # -> ListA, ListB

# ---- group: RH_Input
# Author: Benjamin Howes
# Contact: BHowes@Pratt.edu
# Date: 2/21/2015
# Revision: 001
pt = Point(Point(0, 0, 0))

pt_2 = Point(Point(0, 0, 0))

# ---- group: Input
pt_3 = Point(Point(0, 0, 0))

pt_4 = Point(Point(0, 0, 0))

# ---- group: Operation
pt_5 = Point(Point(0, 0, 0))

pt_6 = Point(Point(0, 0, 0))

pt_7 = Point(Point(0, 0, 0))

pt_8 = Point(Point(0, 0, 0))

# ---- group: Meshed Surface
mesh = Mesh(mesh_uv)

mesh_2 = Mesh(mesh)

# ---- group: Mesh To Load
mat_2 = Material(MaterialType=1)
femesh = FEMesh(Meshes=mesh_2, Material=mat_2, Thickness="0.01", AreaLoad=Vector(0, 0, 0), NormalAreaLoad=0)

# ---- group: Edge Points
pt_9 = Point(dispatch.ListA)

pt_10 = Point(pt_9)

# ---- group: Create Point Supports
toggle = BooleanToggle(False)
mat_3 = MillC_StockSupportType(X=True, Y=True, Z=True, RX=toggle, RY=toggle, RZ=toggle)
fepointsupports = FEPointSupports(Point=pt_10, SupportType=mat_3)

# ---- group: Top Chords
crv_2 = Curve(spacetruss_1.LinesA)

# 2) Set up stuctural model with Millipede
crv_3 = Curve(crv_2)

# ---- group: Create I Beams from Curves
csection = MillC_CrossSection(Material=mat, Width=number_slider, Height=number_slider_2, T1=flange_thickness, T2=flange_thickness, CrossSectionType=7)
fcurves = FrameCurves(Curves=crv_3, CrossSection=csection, LinearLoad=Vector(0, 0, 0), SupportType=0)

# ---- group: Btm Chords and Webs
crv_4 = Curve([spacetruss_1.LinesB, spacetruss_1.Web])

crv_5 = Curve(crv_4)

# ---- group: Create Pipes from Curves
csection_2 = MillC_CrossSection(Material=mat, InnerRadius=number_slider_3, Thickness=flange_thickness_2, CrossSectionType=1)
fcurves_2 = FrameCurves(Curves=crv_5, CrossSection=csection_2, LinearLoad=Vector(0, 0, 0), SupportType=0)

# ---- group: MILLIPEDE FEA SOLVER!!! / CREATE FEA SYSTEM
# 3) Run structural analysis and visualize results
fe_system = FESystem(
    ModelComponents=flatten([fepointsupports, fcurves_2, fcurves, femesh, load_region]),
    IntersectAddedCurves=False,
    MergeTolerance=0.01,
    MinimumCurveSpan=0.05,
    MaximumCurveSpan=10000,
    CurveTolerance=0.1)

# ---- group: Output
pt_11 = Point(Point(0, 0, 0))

pt_12 = Point(Point(0, 0, 0))

# ---- group: Meshed Surface
mesh_3 = Mesh(mesh)

# ---- group: Btm Chords and Webs
crv_6 = Curve(crv_4)

# ---- group: Top Chords
crv_7 = Curve(crv_2)

# ---- group: Edge Points
pt_13 = Point(pt_9)

# ---- group: MILLIPEDE FEA SOLVER!!!
self_weight_coef = Slider(1.225, range=0.5..3)

# ---- group: Visualization
pt_14 = Point(Point(0, 0, 0))

pt_15 = Point(Point(0, 0, 0))

# ---- group: MILLIPEDE FEA SOLVER!!! / Run Analysis
fe_solver = FESolver(
    FEModel=fe_system,
    SelfWeightCoefficient=self_weight_coef,
    BeamOptimisationIterations=0,
    QuadOptimisationIterations=0,
    OptimizationTarget=0.3,
    OptimizationPenalization=2,
    LoadCase=0,
    AllCases=True)  # -> FEModel, MaxDeflection, Weight

# ----
deflection_m = Panel(fe_solver.MaxDeflection)
weight_kg = Panel(fe_solver.Weight)

# ---- group: RESULTS VISUALIZATION / Visualize Deflection
slider = Slider(0, range=0..20)

# ---- group: RESULTS VISUALIZATION
division = Division(A=slider, B=fe_solver.MaxDeflection)
frame_visualization = FrameVisualization(
    FEModel=fe_solver.FEModel,
    DetailedOutput=True,
    Deflection=division,
    Inflation=0,
    Subdivision="0",
    OptScale=False,
    ColorMode=5)  # -> Curves, Meshes, CompleteRange, VisibleRange
mesh_4 = Mesh(frame_visualization.Meshes)
