# Grasshopper definition DF_StructuresWorkshop_EX1_20150221_BROKEN.gh (Grasshopper 0.9.76)
# plug-ins: LunchBox, Millipede

# ---- group: I Beam Inputs (Meters)
number_slider = Slider(0.25, range=0.1..0.5)
number_slider_2 = Slider(0.75, range=0.1..1)
flange_thickness = Slider(0.015, range=0.01..0.1)

# ---- group: Pipe Inputs (Meters)
number_slider_3 = Slider(0.1, range=0.1..0.5)
flange_thickness_2 = Slider(0.01, range=0.01..0.1)

# ---- group: Create Point Supports
toggle = BooleanToggle(False)
mat = MillC_StockSupportType(X=True, Y=True, Z=True, RX=toggle, RY=toggle, RZ=toggle)
fepointsupports = FEPointSupports(SupportType=mat)

# ----
# 1) Generate Truss with Lunchbox
U = Slider(11, range=5..25)
V = Slider(11, range=5..25)
truss_depth = Slider(2.5, range=1..5)

area_load_in_n_m2 = Slider(0, range=0..3000)

# ---- group: RH_LoadingBrep
brep = Brep(<brep referenced from the Rhino model>)

# ---- group: Mesh To Load
mat_2 = Material(MaterialType=1)
femesh = FEMesh(Material=mat_2, Thickness="0.01", AreaLoad=Vector(0, 0, 0), NormalAreaLoad=0)

# ---- group: RH_InputCurves
# Example 1
# Long Span Space Frame with Millipede Analysis
crv = Curve([<curve referenced from the Rhino model> x3])

# ---- group: Define Material
mat_3 = Material(MaterialType=2)

# ---- group: Create I Beams from Curves
csection = MillC_CrossSection(Width=number_slider, Height=number_slider_2, T1=flange_thickness, T2=flange_thickness, CrossSectionType=7)
fcurves = FrameCurves(LinearLoad=Vector(0, 0, 0), SupportType=0)

# ---- group: Create Pipes from Curves
csection_2 = MillC_CrossSection(InnerRadius=number_slider_3, Thickness=flange_thickness_2, CrossSectionType=1)
fcurves_2 = FrameCurves(CrossSection=csection_2, LinearLoad=Vector(0, 0, 0), SupportType=0)

# ---- group: Load shells within Brep
multiplication = Multiplication(B="-1")
Z = UnitZ(Factor=multiplication)
load_region = LoadRegion(AreaLoad=Z)

# ---- group: Loft input crvs and generate Spaceframe
loft = Loft(Options={Adjust=False, Closed=False, LoftEnds=0, LoftSimp=0, LoftType=0, Rebuild=10, Refit=0.01})
multiplication_2 = Multiplication(A=truss_depth, B="-1")
spacetruss_1 = SpaceTrussStructure1(Surface=loft, UDivisions=10, VDivisions=10, TrussDepth=multiplication_2)  # -> LinesA, LinesB, Web, Nodes
mesh_uv = MeshSurface(Surface=loft, UCount=5, VCount=5, Overhang=True, Equalize=False)

# ---- group: Find nodes at edges
panel = Panel("""0
2""")
item = ListItem(Index=panel, Wrap=True)
pull = PullPoint(Geometry=item, ClosestOnly=True)  # -> ClosestPoint, Distance
smaller = SmallerThan(FirstNumber=pull.Distance, SecondNumber=".001")  # -> SmallerThan, OrEqualTo
dispatch = Dispatch(DispatchPattern=smaller.SmallerThan)  # -> ListA, ListB

# ---- group: RH_Input
# Author: Benjamin Howes
# Contact: BHowes@Pratt.edu
# Date: 2/21/2015
# Revision: 001
pt = Point(Point(0, 0, 0))

pt_2 = Point(Point(0, 0, 0))

# ---- group: Input
pt_3 = Point(Point(0, 0, 0))

pt_4 = Point(Point(0, 0, 0))

# ---- group: Operation
pt_5 = Point(Point(0, 0, 0))

pt_6 = Point(Point(0, 0, 0))

pt_7 = Point(Point(0, 0, 0))

pt_8 = Point(Point(0, 0, 0))

# ---- group: Meshed Surface
mesh = Mesh()

mesh_2 = Mesh(mesh)

# ---- group: Edge Points
pt_9 = Point()

pt_10 = Point(pt_9)

# ---- group: Top Chords
crv_2 = Curve()

# 2) Set up stuctural model with Millipede
crv_3 = Curve(crv_2)

# ---- group: Btm Chords and Webs
crv_4 = Curve([<curve referenced from the Rhino model> x236])

crv_5 = Curve(crv_4)

# ---- group: MILLIPEDE FEA SOLVER!!! / CREATE FEA SYSTEM
# 3) Run structural analysis and visualize results
fe_system = FESystem(IntersectAddedCurves=False, MergeTolerance=0.01, MinimumCurveSpan=0.05, MaximumCurveSpan=10000, CurveTolerance=0.1)

# ---- group: Output
pt_11 = Point(Point(0, 0, 0))

pt_12 = Point(Point(0, 0, 0))

# ---- group: Meshed Surface
mesh_3 = Mesh(mesh)

# ---- group: Top Chords
crv_6 = Curve(crv_2)

# ---- group: Edge Points
pt_13 = Point(pt_9)

# ---- group: Btm Chords and Webs
crv_7 = Curve(crv_4)

# ---- group: MILLIPEDE FEA SOLVER!!!
self_weight_coef = Slider(1.225, range=0.5..3)

# ---- group: Visualization
pt_14 = Point(Point(0, 0, 0))

pt_15 = Point(Point(0, 0, 0))

# ---- group: MILLIPEDE FEA SOLVER!!! / Run Analysis
fe_solver = FESolver(
    FEModel=fe_system,
    SelfWeightCoefficient=self_weight_coef,
    BeamOptimisationIterations=0,
    QuadOptimisationIterations=0,
    OptimizationTarget=0.3,
    OptimizationPenalization=2,
    LoadCase=0,
    AllCases=True)  # -> FEModel, MaxDeflection, Weight

# ----
deflection_m = Panel(fe_solver.MaxDeflection)
weight_kg = Panel(fe_solver.Weight)

# ---- group: RESULTS VISUALIZATION / Visualize Deflection
slider = Slider(0, range=0..20)

# ---- group: RESULTS VISUALIZATION
division = Division(A=slider)
frame_visualization = FrameVisualization(DetailedOutput=True, Deflection=division, Inflation=0, Subdivision="0", OptScale=False, ColorMode=5)  # -> Curves, Meshes, CompleteRange, VisibleRange
mesh_4 = Mesh(frame_visualization.Meshes)
