# Grasshopper definition DF_StructuresWorkshop_EX2_20150221.gh (Grasshopper 0.9.76)
# plug-ins: Kangaroo Components, Millipede

# ---- group: RH_Input Surface
# Author: Benjamin Howes
# Contact: BHowes@Pratt.edu
# Date: 2/21/2015
# Revision: 001
# Example 2
# Kangaroo Form Finding + Millipede Analysis
# 1) Reference Rhino Geometry
# and Create Base Mesh
srf = Surface(<surface referenced from the Rhino model>)

# ---- group: Mesh Subdivision
number_slider = Slider(20, range=10..50)
number_slider_2 = Slider(40, range=10..50)

# ---- group: RH_Fixed Point Breps
pipeline = GeometryPipeline(
    GroupByLayer=False,
    GroupByType=False,
    IncludeHidden=True,
    IncludeLocked=True,
    LayerFilter="GH_InputFixBREPS",
    NameFilter="*",
    TypeFilter=1073741848)

# ---- group: Kangaroo Forces
gravity = Slider(198, range=1..1000)
spring_stiffness = Slider(1583, range=1..5000)

# ---- group: RH_LoadingBREP
# 3) Millipede Shell Analysis
brep = Brep(<brep referenced from the Rhino model>)

# ----
area_load_in_n_m2 = Slider(3000, range=0..3000)
material_thickness = Slider(0.1, range=0.001..0.1)

# ---- group: Load shells within Brep
multiplication = Multiplication(A=area_load_in_n_m2, B="-1")
Z = UnitZ(Factor=multiplication)
load_region = LoadRegion(Boundary=brep, AreaLoad=Z)

# ---- group: Mesh Surface for form finding
mesh_uv = MeshSurface(Surface=srf, UCount=number_slider, VCount=number_slider_2, Overhang=True, Equalize=False)

# ---- group: In-Line Kangaroo settings --- use these instead of a timer!
simulation_steps = Slider(808, range=10..5000)
kangaroo_settings = KangarooSettings(
    Tolerance=0.001,
    TimeStep=0.01,
    SubIterations=simulation_steps,
    Floor=False,
    Drag=1,
    Restitution=0.7,
    StaticFriction=10,
    KineticFriction=10,
    Settle=2,
    Tumble=1,
    Sound=False,
    Solver=0)
panel = Panel("""1
0""")

# ---- group: Base Mesh
mesh = Mesh(mesh_uv)

mesh_2 = Mesh(mesh)

# ---- group: Get Mesh Properties
demesh = DeconstructMesh(Mesh=mesh_2)  # -> Vertices, Faces, Colours, Normals
medges = MeshEdges(Mesh=mesh_2)  # -> NakedEdges, InteriorEdges, NonManifoldEdges

# ---- group: Fixed Point Breps
brep_2 = Brep(pipeline)

# 2) Form Finding with Kangaroo
brep_3 = Brep(brep_2)

brep_4 = Brep(brep_2)

# ---- group: Fixed Points
mat = MillC_StockSupportType(X=True, Y=True, Z=True, RX=True, RY=True, RZ=True)
support_region = MSupportTypeRegion(Boundary=brep_4, SupportType=mat, AmmendExistingSupports=True)

# ---- group: Find Points in our FixedPointsBreps
brepsinc = PointInBreps(Brep=brep_3, Point=demesh.Vertices, Strict=False)  # -> Inside, Index
dispatch = Dispatch(List=demesh.Vertices, DispatchPattern=brepsinc.Inside)  # -> ListA, ListB

# ---- group: find edge points
pull = PullPoint(Point=demesh.Vertices, Geometry=medges.NakedEdges, ClosestOnly=True)  # -> ClosestPoint, Distance
smaller = SmallerThan(FirstNumber=pull.Distance, SecondNumber=".001")  # -> SmallerThan, OrEqualTo
dispatch_2 = Dispatch(List=demesh.Vertices, DispatchPattern=smaller.SmallerThan)  # -> ListA, ListB

# ---- group: Base Mesh
mesh_3 = Mesh(mesh)

# ---- group: Fixed Point Breps
brep_5 = Brep(brep_2)

# ---- group: RH_Input
pt = Point(Point(0, 0, 0))

pt_2 = Point(Point(0, 0, 0))

# ---- group: Input
pt_3 = Point(Point(0, 0, 0))

pt_4 = Point(Point(0, 0, 0))

# ---- group: MILLIPEDE FEA SOLVER!!!
self_weight_coef = Slider(1.2, range=0..3)

# ---- group: Operation
pt_5 = Point(Point(0, 0, 0))

pt_6 = Point(Point(0, 0, 0))

# ---- group: Allow movement in Z direction only at edges
anchorxyz = AnchorXYZ(Point=dispatch_2.ListA, ConstrainX=True, ConstrainY=True, ConstrainZ=Toggle(False))

# ---- group: - Gravity for Points outside of BREPS
Z_2 = UnitZ(Factor=gravity)
pt_7 = Point(dispatch.ListB)
uforce = UnaryForce(Point=pt_7, Force=Z_2)

# ---- group: Springs!
springs = SpringsFromLine(
    Connection=[medges.NakedEdges, medges.InteriorEdges],
    Stiffness=spring_stiffness,
    Damping=10,
    RestLength=0,
    UpperCutoff=0,
    LowerCutoff=0,
    Plasticity=0)

# ---- group: Operation
pt_8 = Point(Point(0, 0, 0))

pt_9 = Point(Point(0, 0, 0))

# ---- group: Points in BREPS will be anchored
pt_10 = Point(dispatch.ListA)

# ---- group: Output
pt_11 = Point(Point(0, 0, 0))

pt_12 = Point(Point(0, 0, 0))

# ---- group: Visualization
pt_13 = Point(Point(0, 0, 0))

pt_14 = Point(Point(0, 0, 0))

# ---- group: RESULTS VISUALIZATION / Visualize Deflection
slider = Slider(0, range=0..20)

# ---- group: RESULTS VISUALIZATION / Results Plane: -1=bottom, 1=top
slider_2 = Slider(1, range=-1..1)

# ---- group: Kangaroo Physics Simulation
kangaroo = KangarooPhysics(
    ForceObjects=flatten([uforce, anchorxyz, springs]),
    AnchorPoints=pt_10,
    Settings=kangaroo_settings,
    Geometry=mesh_2,
    SimulationReset=panel)  # -> Out, Iterations, ParticlesOut, GeometryOut, KE
item = ListItem(List=kangaroo.GeometryOut, Index="1", Wrap=True)

# ---- group: Kangaroo Mesh Visualization
preview = CustomPreview(Geometry=item, Shader=ColourSwatch(SwatchColor=RGBA(128, 34, 130, 194)))

# ---- group: Kagaroo Mesh
mesh_4 = Mesh(item)

mesh_5 = Mesh(mesh_4)

# ---- group: Assign Material to Mesh
mat_2 = Material(MaterialType=5)
femesh = FEMesh(Meshes=mesh_5, Material=mat_2, Thickness=material_thickness, AreaLoad=Vector(0, 0, 0), NormalAreaLoad=0)

# ---- group: MILLIPEDE FEA SOLVER!!! / CREATE FEA SYSTEM
fe_system = FESystem(
    ModelComponents=[femesh, support_region, load_region],
    IntersectAddedCurves=True,
    MergeTolerance=0.0001,
    MinimumCurveSpan=0.05,
    MaximumCurveSpan=10000,
    CurveTolerance=0.1)

# ---- group: MILLIPEDE FEA SOLVER!!! / FEA SOLVER
fe_solver = FESolver(
    FEModel=fe_system,
    SelfWeightCoefficient=self_weight_coef,
    BeamOptimisationIterations=0,
    QuadOptimisationIterations=0,
    OptimizationTarget=0.3,
    OptimizationPenalization=2,
    LoadCase=0,
    AllCases=True)  # -> FEModel, MaxDeflection, Weight

# ----
deflection_m = Panel(fe_solver.MaxDeflection)

# ---- group: RESULTS VISUALIZATION
division = Division(A=slider, B=fe_solver.MaxDeflection)
mesh_visualization = MeshVisualization(FEModel=fe_solver.FEModel, Deflection=division, Plane=slider_2, ShowThickness=Toggle(False), ColorMode=5)  # -> Mesh, CompleteRange, VisibleRange

# ---- group: Kagaroo Mesh
mesh_6 = Mesh(mesh_4)
