# Grasshopper definition DFWS_15SP_06-01_Grids.gh (Grasshopper 0.9.76)
# plug-ins: Weaverbird, SMART Form Grasshopper

mesh = Mesh(<mesh referenced from the Rhino model>)
crv = Curve([<curve referenced from the Rhino model> x860])
mesh_2 = Mesh(<mesh referenced from the Rhino model>)
crv_2 = Curve([<curve referenced from the Rhino model> x99])
srf = Surface(<surface referenced from the Rhino model>)
srf_2 = Surface(<surface referenced from the Rhino model>)
mesh_to_smesh = MeshToSmartMesh(Mesh=mesh)
mesh_to_smesh_2 = MeshToSmartMesh(Mesh=mesh_2)
ln_to_smesh = LinesToSmartMesh(Lines=crv)
wbtile = WeaverbirdsTile(MeshCurves=crv_2, FillStrategy=Slider(7, range=0..7), OptIn=2)
srf_to_smesh = SurfaceToSmartMesh(Surface=srf, NumberU=Slider(20, range=1..50), NumberV=Slider(20, range=1..50))
mesh_uv = MeshSurface(Surface=srf_2, UCount=Slider(20, range=1..50), VCount=Slider(20, range=1..50), Overhang=True, Equalize=False)
smesh_to_mesh = SmartMeshToMesh(SmartMesh=mesh_to_smesh)
smesh_to_mesh_2 = SmartMeshToMesh(SmartMesh=ln_to_smesh)
mesh_to_smesh_3 = MeshToSmartMesh(Mesh=wbtile)
smesh_to_mesh_3 = SmartMeshToMesh(SmartMesh=srf_to_smesh)
mesh_to_smesh_4 = MeshToSmartMesh(Mesh=mesh_uv)
smesh_to_mesh_4 = SmartMeshToMesh(SmartMesh=mesh_to_smesh_2)
crv_to_weaverbird_to_sgmesh = Data(mesh_to_smesh_3)
gh_srf_msh_to_sgmesh = Data(mesh_to_smesh_4)
tri_mesh_to_sgmesh = Data(mesh_to_smesh_2)
surface_to_sgmesh = Data(srf_to_smesh)
curves_to_sgmesh = Data(ln_to_smesh)
mesh_to_sgmesh = Data(mesh_to_smesh)
plugin_in_selected_mesh = Data(mesh_to_sgmesh)
smesh_to_mesh_5 = SmartMeshToMesh(SmartMesh=plugin_in_selected_mesh)
wbnaked = WeaverbirdsNakedBoundary(MeshClosedPolylines=smesh_to_mesh_5)
smartform = SmartForm(
    SmartMesh=plugin_in_selected_mesh,
    ConstrainGeometry=wbnaked,
    Stiffness=1,
    SlackLength=1,
    Weight=1,
    Inflation=0,
    MaxIterations=10,
    Attr=True,
    Auto=False,
    ConstCrv=True,
    ConstPt=True,
    ConstSrf=True,
    DampingValue=0.1,
    IfTimer=True,
    TimeStepValue=0.5)  # -> RelaxedSmartMesh, Iterations, TotalForce
smesh_to_mesh_6 = SmartMeshToMesh(SmartMesh=smartform.RelaxedSmartMesh)
