# Grasshopper definition DFWS_15SP_06-03_Analysis.gh (Grasshopper 0.9.76)
# plug-ins: Weaverbird, SMART Form Grasshopper

mesh = Mesh(<mesh referenced from the Rhino model>)
wbnaked = WeaverbirdsNakedBoundary(MeshClosedPolylines=mesh)
cp = ControlPoints(Curve=wbnaked)  # -> flatten(Points), Weights, Knots
mesh_to_smesh = MeshToSmartMesh(Mesh=mesh)  # -> simplify(SmartMesh)
smartform = SmartForm(
    SmartMesh=mesh_to_smesh,
    ConstrainGeometry=cp.Points,
    Stiffness=1,
    SlackLength=1,
    Weight=1,
    Inflation=0,
    MaxIterations=10,
    Attr=True,
    Auto=False,
    ConstCrv=True,
    ConstPt=True,
    ConstSrf=True,
    DampingValue=0.1,
    IfTimer=True,
    TimeStepValue=0.5)  # -> RelaxedSmartMesh, Iterations, TotalForce
smartformanalyser = SmartFormAnalyser(
    SmartMesh=smartform.RelaxedSmartMesh,
    AutoLimits=True,
    LowerLimit=0,
    UpperLimit=1,
    Linear=False,
    Selected_analysis_index=0,
    Selected_geometrytype_index=0,
    Grip0_Factor=0,
    Grip1_Factor=0.5,
    Grip2_Factor=1)  # -> SmartMesh, Data
