# Grasshopper definition DFWS_15SP_06-04_NonPlanar.gh (Grasshopper 0.9.76)
# plug-ins: Weaverbird, SMART Form Grasshopper

srf = Surface()
srf_2 = Surface()
mesh = Mesh()
srf_to_smesh = SurfaceToSmartMesh(Surface=srf, NumberU=Slider(30, range=1..50), NumberV=Slider(10, range=1..50))
mesh_uv = MeshSurface(Surface=srf_2, UCount=Slider(30, range=1..50), VCount=Slider(10, range=1..50), Overhang=True, Equalize=False)
mesh_to_smesh = MeshToSmartMesh(Mesh=mesh)
wbnaked = WeaverbirdsNakedBoundary(MeshClosedPolylines=mesh)
mesh_to_smesh_2 = MeshToSmartMesh(Mesh=mesh_uv)
wbnaked_2 = WeaverbirdsNakedBoundary(MeshClosedPolylines=mesh_uv)
smesh_to_mesh = SmartMeshToMesh(SmartMesh=srf_to_smesh)
wbnaked_3 = WeaverbirdsNakedBoundary(MeshClosedPolylines=smesh_to_mesh)
cp = ControlPoints(Curve=wbnaked_3)  # -> flatten(Points), Weights, Knots
cp_2 = ControlPoints(Curve=wbnaked)  # -> flatten(Points), Weights, Knots
cp_3 = ControlPoints(Curve=wbnaked_2)  # -> flatten(Points), Weights, Knots
smartform = SmartForm(
    SmartMesh=mesh_to_smesh,
    ConstrainGeometry=cp_2.Points,
    Stiffness=1,
    SlackLength=1,
    Weight=1,
    Inflation=0,
    MaxIterations=10,
    Attr=True,
    Auto=False,
    ConstCrv=True,
    ConstPt=True,
    ConstSrf=True,
    DampingValue=0.1,
    IfTimer=True,
    TimeStepValue=1)  # -> RelaxedSmartMesh, Iterations, TotalForce
smartform_2 = SmartForm(
    SmartMesh=mesh_to_smesh_2,
    ConstrainGeometry=cp_3.Points,
    Stiffness=1,
    SlackLength=1,
    Weight=1,
    Inflation=0,
    MaxIterations=10,
    Attr=True,
    Auto=False,
    ConstCrv=True,
    ConstPt=True,
    ConstSrf=True,
    DampingValue=0.1,
    IfTimer=True,
    TimeStepValue=1)  # -> RelaxedSmartMesh, Iterations, TotalForce
smartform_3 = SmartForm(
    SmartMesh=srf_to_smesh,
    ConstrainGeometry=cp.Points,
    Stiffness=1,
    SlackLength=1,
    Weight=1,
    Inflation=0,
    MaxIterations=10,
    Attr=True,
    Auto=False,
    ConstCrv=True,
    ConstPt=True,
    ConstSrf=True,
    DampingValue=0.1,
    IfTimer=True,
    TimeStepValue=1)  # -> RelaxedSmartMesh, Iterations, TotalForce
smesh_to_mesh_2 = SmartMeshToMesh(SmartMesh=smartform_3.RelaxedSmartMesh)
smesh_to_mesh_3 = SmartMeshToMesh(SmartMesh=smartform.RelaxedSmartMesh)
smesh_to_mesh_4 = SmartMeshToMesh(SmartMesh=smartform_2.RelaxedSmartMesh)
