# Grasshopper definition DFWS_15SP_06-05_Constraints.gh (Grasshopper 0.9.76)
# plug-ins: SMART Form Grasshopper

mesh = Mesh()
pt = Point()
crv = Curve()
srf = Surface()
mesh_to_smesh = MeshToSmartMesh(Mesh=mesh)
smartform = SmartForm(
    SmartMesh=mesh_to_smesh,
    ConstrainGeometry=[pt, crv, srf],
    Stiffness=Slider(0.064, range=0..1),
    SlackLength=Slider(1, range=0..1),
    Weight=Slider(1, range=-1..1),
    Inflation=0,
    MaxIterations=10,
    Attr=True,
    Auto=False,
    ConstCrv=True,
    ConstPt=True,
    ConstSrf=True,
    DampingValue=0.1,
    IfTimer=True,
    TimeStepValue=0.08)  # -> RelaxedSmartMesh, Iterations, TotalForce
smesh_to_mesh = SmartMeshToMesh(SmartMesh=smartform.RelaxedSmartMesh)
