# Grasshopper definition DFWS_15SP_06-06_PanelGrouping.gh (Grasshopper 0.9.76)
# plug-ins: SMART Form Grasshopper

srf = Surface()
mesh = Mesh()
pt = Point()
mesh_to_smesh = MeshToSmartMesh(Mesh=mesh)
smartgrids = SmartGrids(
    Surface=srf,
    NumberU=Slider(10, range=1..20),
    NumberV=Slider(10, range=1..20),
    SeedPointU=Slider(0.5, range=0..1),
    SeedPointV=Slider(0.5, range=0..1),
    FirstAngle=Slider(0, range=0..360),
    InnerAngle=Slider(90, range=0..360),
    Selected_Index=[0, 0, 1],
    Boolen_checked=[False, False, False, False, False, False, False, False],
    SMART_Slider9_Decimals=2,
    SMART_Slider9_Max=1,
    SMART_Slider9_Min=0,
    SMART_Slider9_Value=1,
    SMART_Slider10_Decimals=2,
    SMART_Slider10_Max=1,
    SMART_Slider10_Min=0,
    SMART_Slider10_Value=1)
smartform = SmartForm(
    SmartMesh=mesh_to_smesh,
    ConstrainGeometry=pt,
    Stiffness=Slider(1, range=0..1),
    SlackLength=Slider(1, range=0..1),
    Weight=1,
    Inflation=0,
    MaxIterations=10,
    Attr=True,
    Auto=False,
    ConstCrv=True,
    ConstPt=True,
    ConstSrf=True,
    DampingValue=0.1,
    IfTimer=True,
    TimeStepValue=1)  # -> RelaxedSmartMesh, Iterations, TotalForce
smesh_to_mesh = SmartMeshToMesh(SmartMesh=smartgrids)
smesh_to_mesh_2 = SmartMeshToMesh(SmartMesh=smartform.RelaxedSmartMesh)
smart_clustering = SmartClustering(
    SmartMesh=smartform.RelaxedSmartMesh,
    NumberOfCluster=Slider(30, range=1..50),
    Tolerance=Slider(0.25, range=0..5),
    Selected_Index=[1, 1],
    SMART_String_Value=["Status: Done", "0", "0.0684", "0", "72", "Max Corner Distance", "Freq."])  # -> SmartMesh, PanelOutline, port, Brep, Cluster, CornerDeviance, port_2, port_3
bnd = Bounds(Numbers=smart_clustering.Cluster)
remap = RemapNumbers(Value=smart_clustering.Cluster, Source=bnd, Target=Domain(0, 1))  # -> Mapped, Clipped
ded = DeconstructDomain(Domain=bnd)  # -> Start, End
panel = Panel(ded.End)
gradient = Gradient(
    LowerLimit=0,
    UpperLimit=1,
    Parameter=remap.Mapped,
    stops=[0: RGB(243, 57, 0), 0.1: RGB(236, 27, 60), 0.2: RGB(210, 0, 118), 0.3: RGB(103, 0, 120), 0.4: RGB(39, 72, 161), 0.5: RGB(1, 192, 229), 0.6: RGB(18, 178, 90), 0.7: RGB(79, 186, 8), 0.8: RGB(220, 237, 32), 0.9: RGB(247, 159, 20), 1: RGB(243, 57, 0)])
preview = CustomPreview(Geometry=smart_clustering.Brep, Shader=gradient)
