# Grasshopper definition DFWS_15SP_06-07_Galapagos.gh (Grasshopper 0.9.76)

number_slider = Slider(37.75508, range=0..90)
mesh = Mesh(<mesh referenced from the Rhino model>)
number_slider_2 = Slider(123.06665, range=0..180)
number_slider_3 = Slider(0.46154, range=0..180)
cluster = Cluster(geo=mesh, Z=number_slider_2, Y=number_slider_3, X=number_slider)
bbox = BoundingBox(Content=cluster, Plane=PlaneXY(0, 0, 0))  # -> Box, Box_2
volume = Volume(Geometry=bbox.Box)  # -> Volume, Centroid
num = Number(volume.Volume)
galapagos = Galapagos(fitness=num, gene=[number_slider, number_slider_3, number_slider_2])

# ==== cluster Cluster
geo = ClusterInput()
Z = ClusterInput()
Y = ClusterInput()
X = ClusterInput()
geo_2 = Geometry(geo)
rad = Radians(Degrees=Z)
rad_2 = Radians(Degrees=Y)
rad_3 = Radians(Degrees=X)
volume = Volume(Geometry=geo_2)  # -> Volume, Centroid
xy = XYPlane(Origin=volume.Centroid)
xz = XZPlane(Origin=volume.Centroid)
yz = YZPlane(Origin=volume.Centroid)
rotate = Rotate(Geometry=geo_2, Angle=rad, Plane=xy)  # -> Geometry, Transform
rotate_2 = Rotate(Geometry=rotate.Geometry, Angle=rad_2, Plane=xz)  # -> Geometry, Transform
rotate_3 = Rotate(Geometry=rotate_2.Geometry, Angle=rad_3, Plane=yz)  # -> Geometry, Transform
G = ClusterOutput(rotate_3.Geometry)
