# Grasshopper definition DFWS_15SP_06-07_Octopus.gh (Grasshopper 0.9.76)
# plug-ins: Octopus

genes = GenePool(Decimals=0, Maximum=999, Minimum=0, Value=[672.628333, 408.8978884, 499.5, 499.5])
crv = Curve([<curve referenced from the Rhino model> x7])
mesh = Mesh([<mesh referenced from the Rhino model> x4])
bbox = BoundingBox(Content=crv, Plane=PlaneXY(0, 0, 0), UnionBox=True)  # -> Box, Box_2
volume = Volume(Geometry=mesh)  # -> Volume, Centroid
box_corners = BoxCorners(Box=bbox.Box)  # -> CornerA, CornerB, CornerC, CornerD, CornerE, CornerF, CornerG, CornerH
dist = Distance(PointA=box_corners.CornerA, PointB=box_corners.CornerB)
dist_2 = Distance(PointA=box_corners.CornerA, PointB=box_corners.CornerE)
dist_3 = Distance(PointA=box_corners.CornerA, PointB=box_corners.CornerD)
division = Division(A=dist_3, B="10")
division_2 = Division(A=dist_2, B="10")
division_3 = Division(A=dist, B="10")
series = Series(Start=0, Step=division_3, Count=expr("X+1", "10"))
series_2 = Series(Start=0, Step=division, Count=expr("X+1", "10"))
series_3 = Series(Start=0, Step=division_2, Count=expr("X+1", "10"))
pt = ConstructPoint(XCoordinate=graft(series), YCoordinate=series_2, ZCoordinate=0)  # -> simplify(flatten(Point))
Z = UnitZ(Factor=series_3)
addition = Addition(A=graft(pt), B=Z)  # -> simplify(flatten(Result))
addition_2 = Addition(A=box_corners.CornerA, B=addition)
item = ListItem(List=addition_2, Index=genes, Wrap=True)
vec2pt = Vector2Pt(PointA=volume.Centroid, PointB=item, Unitize=False)  # -> Vector, Length
move = Move(Geometry=mesh, Motion=vec2pt.Vector)  # -> Geometry, Transform
vb = VBScript(x=move.Geometry)  # -> out, A, B; inputs x: list
# ---------- vb: VB ----------
    Dim i,j As Integer
    
    Dim arrSingle, arrOut As New datatree(Of Object)
    
    For i = 0 To x.count() - 1 Step 1
      arrSingle.add(x.item(i), New gh_path(i))
      For j = 0 To x.count() - 1 Step 1
        If i <> j Then arrOut.add(x.item(j), New gh_path(i))
      Next
    Next
    
    A = arrSingle
    B = arrOut
# ---------- end vb ----------
mbox = MeshBox(Base=bbox.Box, XCount=10, YCount=10, ZCount=10)
mmx = MeshMesh(MeshA=vb.A, MeshB=mbox, UseMeshMeshFast=True)
mmx_2 = MeshMesh(MeshA=vb.A, MeshB=vb.B, UseMeshMeshFast=True)  # -> simplify(Intersections)
bbox_2 = BoundingBox(Content=move.Geometry, Plane=PlaneXY(0, 0, 0), UnionBox=True)  # -> Box, Box_2
lng = ListLength(List=mmx_2)
lng_2 = ListLength(List=mmx)
volume_2 = Volume(Geometry=bbox_2.Box)  # -> Volume, Centroid
ma = MassAddition(Input=flatten(lng))  # -> Result, PartialResults
ma_2 = MassAddition(Input=flatten(lng_2))  # -> Result, PartialResults
self_int = Number(flatten(ma.Result))
volume_3 = Number(flatten(volume_2.Volume))
bound_int = Number(flatten(ma_2.Result))
octopus = Octopus(Phenotype=move.Geometry, OctopusData_gene=genes, OctopusData_obj=[self_int, bound_int, volume_3])
